# Grasshopper definition Building.ghx (Grasshopper 1.0.7)
# plug-ins: Grasshopper-BricsCAD-Connection

# ---- group: Input
thickness_slab = Slider(0.4, range=0..1)
thickness_wall = Slider(0.5, range=0..1)
height_story = Slider(4.1, range=2..10)
entity = Entity({BcDocName="Building", Handle=185, Index=0, SubentityType=0})

# ---- group: Compute height and starting point
bbox = BoundingBox(Content=entity, Plane=PlaneXY(0, 0, 0))  # -> Box, Box_2
debox = DeconstructBox(Box=bbox.Box)  # -> Plane, X, Y, Z
dedomain = DeconstructDomain(Domain=debox.Y)  # -> Start, End
dedomain_2 = DeconstructDomain(Domain=debox.X)  # -> Start, End
dedomain_3 = DeconstructDomain(Domain=debox.Z)  # -> Start, End
pt = ConstructPoint(XCoordinate=dedomain_2.Start, YCoordinate=dedomain.Start, ZCoordinate=dedomain_3.Start)

# ---- group: Divide extrusion per slab height
brep = Brep(entity)
contour = Contour(Shape=brep, Point=pt, Direction=Vector(0, 0, 1), Distance=height_story)  # -> flatten(Contours)

# ---- group: Offset the curves by thickness of wall
planar = Planar(Curve=contour)  # -> Planar, Plane, Deviation
offset = OffsetCurve(Curve=contour, Distance=expr("-x", thickness_wall), Plane=planar.Plane, Corners=1)  # -> flatten(Curve)

# ---- group: Make the bottom surface of the wall
explode = Explode(Curve=contour, Recursive=True)  # -> simplify(Segments), Vertices
disc = Discontinuity(Curve=contour, Level=1)  # -> Points, Parameters
disc_2 = Discontinuity(Curve=offset, Level=1)  # -> Points, Parameters
explode_2 = Explode(Curve=offset, Recursive=True)  # -> simplify(Segments), Vertices
ln = Line(StartPoint=disc.Points, EndPoint=disc_2.Points)  # -> simplify(Line)
shift = ShiftList(List=ln, Shift=1, Wrap=True)  # -> simplify(List)
flip = FlipMatrix(Data=explode.Segments)
flip_2 = FlipMatrix(Data=ln)
flip_3 = FlipMatrix(Data=shift)
flip_4 = FlipMatrix(Data=explode_2.Segments)
boundary = BoundarySurfaces(Edges=[flip, flip_2, flip_4, flip_3])

# ---- group: Select all the stories in BricsCAD
building = Buildings({"Building"}, selected="Building")
st = Stories(Building=building)

# ---- group: Compute amount of stories
division = Division(A=dedomain_3.End, B=height_story)
round = Round(Number=division)  # -> Nearest, Floor, Ceiling

# ---- group: Split into lower floors and roof
boundary_2 = BoundarySurfaces(Edges=offset)
flip_5 = FlipMatrix(Data=boundary_2)
tstat = TreeStatistics(Tree=flip_5)  # -> Paths, Length, Count
lng = ListLength(List=tstat.Paths)
split = SplitList(List=tstat.Paths, Index=expr("x-1", lng))  # -> ListA, ListB

# ---- group: Split into lower floor walls and roof walls
flip_6 = FlipMatrix(Data=boundary)
tstat_2 = TreeStatistics(Tree=flip_6)  # -> Paths, Length, Count
lng_2 = ListLength(List=tstat_2.Paths)
split_2 = SplitList(List=tstat_2.Paths, Index=expr("x-1", lng_2))  # -> ListA, ListB

# ---- group: Get last wall height
multiplication = Multiplication(A=round.Floor, B=height_story)
subtraction = Subtraction(A=dedomain_3.End, B=multiplication)

# ---- group: Correct stories for walls
dom = ConstructDomain(DomainStart=0, DomainEnd=round.Floor)
subset = SubList(List=st, Domain=dom, Wrap=True)  # -> List, Index

# ---- group: Correct stories for slabs
dom_2 = ConstructDomain(DomainStart=0, DomainEnd=expr("x-1", round.Floor))
subset_2 = SubList(List=st, Domain=dom_2, Wrap=True)  # -> List, Index

# ---- group: Correct story for roof
item = ListItem(List=st, Index=round.Floor, Wrap=True)

# ---- group: Extrude lower floors walls
branch = TreeBranch(Tree=flip_6, Path=split_2.ListA, MaintainPaths=True)
Z = UnitZ(Factor=height_story)
extr = Extrude(Base=branch, Direction=Z)
flip_7 = FlipMatrix(Data=extr)

# ---- group: Extrude lower floor slabs
branch_2 = TreeBranch(Tree=flip_5, Path=split.ListA, MaintainPaths=True)
Z_2 = UnitZ(Factor=thickness_slab)
extr_2 = Extrude(Base=branch_2, Direction=Z_2)
flip_8 = FlipMatrix(Data=extr_2)

# ---- group: Extrude roof
branch_3 = TreeBranch(Tree=flip_5, Path=split.ListB, MaintainPaths=True)
Z_3 = UnitZ(Factor=thickness_slab)
extr_3 = Extrude(Base=branch_3, Direction=Z_3)
flip_9 = FlipMatrix(Data=extr_3)

# ---- group: Extrude roof walls
branch_4 = TreeBranch(Tree=flip_6, Path=split_2.ListB, MaintainPaths=True)
Z_4 = UnitZ(Factor=subtraction)
extr_4 = Extrude(Base=branch_4, Direction=Z_4)
flip_10 = FlipMatrix(Data=extr_4)  # -> simplify(Data)

# ---- group: Make the walls
bim_type = BIMTypes({"BimGenericBuildingElt": 0, "BimSection": 1, "BimWall": 2, "BimWindow": 3, "BimDoor": 4, "BimColumn": 5, "BimSlab": 6, "BimBeam": 7, "BimRoom": 8, "BimCovering": 9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}, selected="BimWall")
bbe = BakeBuildingElement(Geometry=[flip_7, flip_10], ElementType=bim_type, SpatialLocation=subset.List)

# ---- group: Make the slabs
bim_type_2 = BIMTypes({"BimGenericBuildingElt": 0, "BimSection": 1, "BimWall": 2, "BimWindow": 3, "BimDoor": 4, "BimColumn": 5, "BimSlab": 6, "BimBeam": 7, "BimRoom": 8, "BimCovering": 9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}, selected="BimSlab")
bbe_2 = BakeBuildingElement(Geometry=flip_8, ElementType=bim_type_2, SpatialLocation=subset_2.List)

# ---- group: Make the roof
bim_type_3 = BIMTypes({"BimGenericBuildingElt": 0, "BimSection": 1, "BimWall": 2, "BimWindow": 3, "BimDoor": 4, "BimColumn": 5, "BimSlab": 6, "BimBeam": 7, "BimRoom": 8, "BimCovering": 9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}, selected="BimRoof": 18)
bbe_3 = BakeBuildingElement(Geometry=flip_9, ElementType=bim_type_3, SpatialLocation=item)
