# Grasshopper definition Busstation.ghx (Grasshopper 1.0.7)
# plug-ins: Grasshopper-BricsCAD-Connection

# ---- group: INPUT
profile_names = ProfilesNames({"IPE", "IPN", "HEA", "HEB", "HEM", "L", "UPN", "CHS", "RHS", "SHS"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}, selected="IPE")
index_of_item_in_profile_sizes_list = Slider(6, range=0..10)
overhang_y_distance = Slider(0.4, range=0..3)
overhang_x_distance = Slider(1.63, range=0..3)
protrusion_of_beams = Slider(0.04, range=0..0.1)
amount_of_columns = Slider(9, range=0..20)
height_column = Slider(4, range=0..5)
thickness_roof = Slider(0.094, range=0..0.5)
curve = Curve({BcDocName="Busstation", Handle=174, Index=0, SubentityType=0})

# ---- group: Define roof shape according to graph mapper
range = Range(Domain=Domain(0, 1), Steps=amount_of_columns)
graph = GraphMapper(
    range,
    x0=0,
    x1=1,
    y0=0,
    y1=1,
    A=0.627669224,
    B=0.279248082,
    container_name="Linear",
    Graph_x0=0.1952428073,
    Graph_x1=0.75,
    Graph_y0=0.4017959833,
    Graph_y1=0.75)
multiplication = Multiplication(A=graph, B=height_column)
Z = UnitZ(Factor=multiplication)

# ---- group: Create profile shape
ps = ProfileSizes(ProfileName=profile_names)
item = ListItem(List=ps, Index=index_of_item_in_profile_sizes_list, Wrap=True)
lp = LibraryProfiles(ProfileName=profile_names, ProfileSize=item)  # -> flatten(Profile)
pi = ProfileInfo(Profile=lp)  # -> ProfileName, ProfileSize, ProfileStandard, ProfileCurves

# ---- group: Divide curve in points
divide = DivideCurve(Curve=curve, Count=amount_of_columns, Kinks=False)  # -> Points, Tangents, Parameters

# ---- group: Turn tangents into normals
pi_2 = Pi(Factor=-0.5)
Z_2 = UnitZ(Factor=1)
Z_3 = UnitZ(Factor=1)
pi_3 = Pi(Factor=0.5)
vrot = Rotate(Vector=divide.Tangents, Axis=Z_3, Angle=pi_3)
vrot_2 = Rotate(Vector=divide.Tangents, Axis=Z_2, Angle=pi_2)
multiplication_2 = Multiplication(A=vrot, B=overhang_x_distance)
multiplication_3 = Multiplication(A=vrot_2, B=overhang_x_distance)

# ---- group: Create defining points
move = Move(Geometry=divide.Points, Motion=Z)  # -> Geometry, Transform
Z_4 = UnitZ(Factor=overhang_y_distance)
Z_5 = UnitZ(Factor=overhang_y_distance)
move_2 = Move(Geometry=move.Geometry, Motion=Z_4)  # -> Geometry, Transform
move_3 = Move(Geometry=move.Geometry, Motion=Z_5)  # -> Geometry, Transform
move_4 = Move(Geometry=move_3.Geometry, Motion=multiplication_3)  # -> Geometry, Transform
move_5 = Move(Geometry=move_2.Geometry, Motion=multiplication_2)  # -> Geometry, Transform

# ---- group: Calculate dimensions of profile
bbox = BoundingBox(Content=pi.ProfileCurves, Plane=PlaneXY(0, 0, 0), UnionBox=True)  # -> Box, Box_2
dim = Dimensions(Surface=bbox.Box)  # -> UDimension, VDimension
division = Division(A=dim.UDimension, B=2)
division_2 = Division(A=dim.VDimension, B=2)

# ----
frame = CurveFrame(Curve=curve, Parameter=divide.Parameters)

# ---- group: Create axes
ln = Line(StartPoint=move_4.Geometry, EndPoint=move.Geometry)
ln_2 = Line(StartPoint=move_5.Geometry, EndPoint=move.Geometry)
ln_3 = Line(StartPoint=divide.Points, EndPoint=move.Geometry)

# ---- group: Create left overhang profiles
ext = ExtendCurve(Curve=ln_2, Type=0, Start=protrusion_of_beams, End=protrusion_of_beams)
end = EndPoints(Curve=ext)  # -> Start, End
dom = ConstructDomain(DomainStart=0, DomainEnd=1)
crvdom = CurveDomain(Curve=ext, Domain=dom)  # -> Curve, Domain
vec2pt = Vector2Pt(PointA=end.Start, PointB=end.End, Unitize=False)  # -> Vector, Length
pframe = PerpFrame(Curve=crvdom.Curve, Parameter=0)
deplane = DeconstructPlane(Plane=pframe)  # -> Origin, XAxis, YAxis, ZAxis
pl = ConstructPlane(Origin=deplane.Origin, XAxis=divide.Tangents, YAxis=deplane.YAxis)
orient = Orient(Geometry=graft(pi.ProfileCurves), Source=PlaneXY(0, 0, 0), Target=pl)  # -> Geometry, Transform
flip = FlipMatrix(Data=orient.Geometry)
boundary = BoundarySurfaces(Edges=flip)  # -> flatten(Surfaces)

# ---- group: Create right overhang profiles
ext_2 = ExtendCurve(Curve=ln, Type=0, Start=protrusion_of_beams, End=protrusion_of_beams)
end_2 = EndPoints(Curve=ext_2)  # -> Start, End
dom_2 = ConstructDomain(DomainStart=0, DomainEnd=1)
crvdom_2 = CurveDomain(Curve=ext_2, Domain=dom_2)  # -> Curve, Domain
vec2pt_2 = Vector2Pt(PointA=end_2.Start, PointB=end_2.End, Unitize=False)  # -> Vector, Length
pframe_2 = PerpFrame(Curve=crvdom_2.Curve, Parameter=0)
deplane_2 = DeconstructPlane(Plane=pframe_2)  # -> Origin, XAxis, YAxis, ZAxis
pl_2 = ConstructPlane(Origin=deplane_2.Origin, XAxis=divide.Tangents, YAxis=deplane_2.YAxis)
orient_2 = Orient(Geometry=graft(pi.ProfileCurves), Source=PlaneXY(0, 0, 0), Target=pl_2)  # -> Geometry, Transform
flip_2 = FlipMatrix(Data=orient_2.Geometry)
boundary_2 = BoundarySurfaces(Edges=flip_2)  # -> flatten(Surfaces)

# ---- group: Create column profiles
X = UnitX(Factor=1)
pl_3 = ConstructPlane(Origin=divide.Points, XAxis=X, YAxis=multiplication_3)
orient_3 = Orient(Geometry=graft(pi.ProfileCurves), Source=PlaneXY(0, 0, 0), Target=frame)  # -> Geometry, Transform
flip_3 = FlipMatrix(Data=orient_3.Geometry)
boundary_3 = BoundarySurfaces(Edges=flip_3)  # -> flatten(Surfaces)

# ---- group: Create left roof
loft = Loft(Curves=ln_2, Options={Adjust=False, Closed=False, LoftEnds=0, LoftSimp=0, LoftType=0, Rebuild=10, Refit=0.01})
Z_6 = UnitZ(Factor=dim.UDimension)
move_6 = Move(Geometry=loft, Motion=Z_6)  # -> Geometry, Transform
Z_7 = UnitZ(Factor=thickness_roof)

# ---- group: Create right roof
loft_2 = Loft(Curves=ln, Options={Adjust=False, Closed=False, LoftEnds=0, LoftSimp=0, LoftType=0, Rebuild=10, Refit=0.01})
Z_8 = UnitZ(Factor=dim.UDimension)
move_7 = Move(Geometry=loft_2, Motion=Z_8)  # -> Geometry, Transform
Z_9 = UnitZ(Factor=thickness_roof)

# ---- group: Output
extr = Extrude(Base=boundary_2, Direction=vec2pt_2.Vector)
extr_2 = Extrude(Base=boundary, Direction=vec2pt.Vector)
extr_3 = Extrude(Base=move_7.Geometry, Direction=Z_9)
extr_4 = Extrude(Base=move_6.Geometry, Direction=Z_7)
extr_5 = Extrude(Base=boundary_3, Direction=ln_3)

# ---- group: Add BIM data
building = BuildingsNames({"Building"}, selected="Building")
element_type = ElementType({"BimGenericBuildingElt": 0, "BimSection": 1, "BimWall": 2, "BimWindow": 3, "BimDoor": 4, "BimColumn": 5, "BimSlab": 6, "BimBeam": 7, "BimRoom": 8, "BimCovering": 9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}, selected="BimColumn")
element_type_2 = ElementType({"BimGenericBuildingElt": 0, "BimSection": 1, "BimWall": 2, "BimWindow": 3, "BimDoor": 4, "BimColumn": 5, "BimSlab": 6, "BimBeam": 7, "BimRoom": 8, "BimCovering": 9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}, selected="BimBeam")
element_type_3 = ElementType({"BimGenericBuildingElt": 0, "BimSection": 1, "BimWall": 2, "BimWindow": 3, "BimDoor": 4, "BimColumn": 5, "BimSlab": 6, "BimBeam": 7, "BimRoom": 8, "BimCovering": 9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}, selected="BimRoof": 18)
story = Story(Building=building)
building_element = BuildingElement(Geometry=extr_5, ElementType=element_type, SpatialLocation=story, Profile=lp)
building_element_2 = BuildingElement(Geometry=[extr_2, extr], ElementType=element_type_2, SpatialLocation=story, Profile=lp)
building_element_3 = BuildingElement(Geometry=[extr_3, extr_4], ElementType=element_type_3, SpatialLocation=story)

# ---- group: Clean up steel connections (with StructuralConnect) after baking
connect = Button()
entity = Entity([building_element, building_element_2])
# To use this script, you have to load following assemblies (right-click and select 'Manage assemblies...') from Program Files > Bricsys > BricsCAD V20:
# - BrxMgd.dll
# - TD_Mgd.dll
# 
# Then press the 'Connect' button to execute the command, after you baked the Building Elements.
structuralconnect = CSharpScript(x=entity, y=connect)  # -> A; inputs x: list, y: Boolean
# ---------- structuralconnect: C# usings ----------
using System.Linq;
using Bricscad.ApplicationServices;
using Teigha.DatabaseServices;
# ---------- structuralconnect: C# ----------
    A = x.ToString();
    var bVal = toggle;
    toggle = y;
    if(!y || bVal)
      return;

    //no message in command line
    var oldCmdEcho = Application.GetSystemVariable("CMDECHO");
    Application.SetSystemVariable("CMDECHO", 0);

    string command = "(command \"BIMSTRUCTURALCONNECT\" \"PRO\"";
    var args = x.Select(objStr => GetHandle((FullSubentityPath) objStr))
      .Aggregate(string.Empty, (s, data) => s + " \"H\" \"" + data + "\" ");
    var fullCommand = command + args + " \"\" \"\")(setvar \"CMDECHO\" " + oldCmdEcho + ")(princ)\n";
    Application.DocumentManager.MdiActiveDocument.SendStringToExecute(fullCommand, true, true, false);
# ---------- structuralconnect: C# additional code ----------
  static bool toggle = false;
  public static string GetHandle(FullSubentityPath fsp)
  {
    return fsp.GetObjectIds()[0].Handle.ToString();
  }
# ---------- end structuralconnect ----------

# ---- group: Post-baking setting of properties
property_category = PropertyCategory({"Standard": 0, "Bricsys": 1, "IFC2x3": 2, "IFCCustom": 3, "User": 4, "Quantity": 5}, selected="Bricsys")
gpn = GetPropertiesNames(BuildingElement=building_element, PropCategory=property_category)
item_2 = ListItem(List=gpn, Index=1, Wrap=True)
spv = SetPropertyValue(BuildingElement=building_element, PropName=item_2, PropVal="Steel column", PropCategory=property_category)

property_category_2 = PropertyCategory({"Standard": 0, "Bricsys": 1, "IFC2x3": 2, "IFCCustom": 3, "User": 4, "Quantity": 5}, selected="Bricsys")
gpn_2 = GetPropertiesNames(BuildingElement=building_element_2, PropCategory=property_category_2)
item_3 = ListItem(List=gpn_2, Index=0, Wrap=True)
spv_2 = SetPropertyValue(BuildingElement=building_element_2, PropName=item_3, PropVal="Steel cantilever", PropCategory=property_category_2)
