# Grasshopper definition Canopy.ghx (Grasshopper 1.0.7)
# plug-ins: Grasshopper-BricsCAD-Connection

curve = Curve({BcDocName="Canopy", Handle=4034, Index=0, SubentityType=0})
curve_2 = Curve({BcDocName="Canopy", Handle=4033, Index=0, SubentityType=0})

# ---- group: INPUT
basic_height_upper_arches = Slider(14000, range=0..100000)
basc_height_lower_arches = Slider(10000, range=0..20000)
height_right_arc = Slider(8000, range=0..30000)
amount_of_shells = Slider(8, range=0..20)
height_left_arc = Slider(8500, range=0..30000)
shell_overhang = Slider(800, range=0..10000)
thickness_shell = Slider(700, range=0..1000)
tilt_of_shells = Slider(6000, range=0..10000)
depth_glass = Slider(50, range=0..100)
line_right = Curve(curve)
line_left = Curve(curve_2)

# ---- group: Make 3 points to construct left arch from line left
divide = DivideCurve(Curve=line_left, Count=2, Kinks=False)  # -> Points, Tangents, Parameters
Z = UnitZ(Factor=height_left_arc)
item = ListItem(List=divide.Points, Index=1, Wrap=True)
move = Move(Geometry=item, Motion=Z)  # -> Geometry, Transform
rot3d = Rotate3D(Geometry=move.Geometry, Angle=degrees(0), Center=item, Axis=line_left)  # -> flatten(Geometry), Transform

# ---- group: Make 3 points to construct right arch from line right
divide_2 = DivideCurve(Curve=line_right, Count=2, Kinks=False)  # -> Points, Tangents, Parameters
Z_2 = UnitZ(Factor=height_right_arc)
item_2 = ListItem(List=divide_2.Points, Index=1, Wrap=True)
move_2 = Move(Geometry=item_2, Motion=Z_2)  # -> Geometry, Transform
rot3d_2 = Rotate3D(Geometry=move_2.Geometry, Angle=degrees(0), Center=item_2, Axis=line_right)  # -> flatten(Geometry), Transform

# ---- group: Make curves (3 arches) from the points in previous step
end = EndPoints(Curve=line_right)  # -> Start, End
end_2 = EndPoints(Curve=line_left)  # -> Start, End
pt = Point([end.Start, rot3d_2.Geometry, end.End])
pt_2 = Point([end_2.Start, rot3d.Geometry, end_2.End])
intcrv = Interpolate(Vertices=pt_2, Degree=3, Periodic=False, KnotStyle=1)  # -> Curve, Length, Domain
intcrv_2 = Interpolate(Vertices=pt, Degree=3, Periodic=False, KnotStyle=1)  # -> Curve, Length, Domain

# ---- group: Make divisions (not regular, but according to graph mapper)
divide_3 = DivideCurve(Curve=intcrv_2.Curve, Count=amount_of_shells, Kinks=False)  # -> graft(Points), Tangents, Parameters
divide_4 = DivideCurve(Curve=intcrv.Curve, Count=amount_of_shells, Kinks=False)  # -> graft(Points), Tangents, Parameters
ln = Line(StartPoint=divide_3.Points, EndPoint=divide_4.Points)  # -> simplify(Line)
crvdom = CurveDomain(Curve=ln)  # -> Curve, Domain
range = Range(Domain=crvdom.Domain, Steps=6)
graph = GraphMapper(
    range,
    x0=0,
    x1=1,
    y0=0,
    y1=1,
    container_name="Bezier",
    cpx=[0, 1, 0.0028996123, 1],
    cpy=[0, 0.4739127755, 0.5666667223, 1])
shatter = Shatter(Curve=ln, Parameters=graph)  # -> simplify(Segments)
end_3 = EndPoints(Curve=shatter)  # -> Start, End
lng = ListLength(List=end_3.End)
item_3 = ListItem(List=end_3.End, Index=expr("x-1", lng), Wrap=True)
combine = CombineData(Input0=[end_3.Start, item_3])  # -> Result, Index

# ---- group: Give section a profile like graph mapper
range_2 = Range(Domain=Domain(0, 1), Steps=6)
graph_2 = GraphMapper(
    range_2,
    x0=0,
    x1=1,
    y0=0,
    y1=1,
    container_name="Sinc",
    Equation_X0=0.5046342611,
    Equation_X1=0.652479589,
    Equation_Y0=0.9904221296,
    Equation_Y1=0.2465652227)
multiplication = Multiplication(A=graph_2, B=basic_height_upper_arches)
multiplication_2 = Multiplication(A=graph_2, B=basc_height_lower_arches)
Z_3 = UnitZ(Factor=multiplication_2)
Z_4 = UnitZ(Factor=multiplication)
move_3 = Move(Geometry=combine.Result, Motion=Z_4)  # -> Geometry, Transform
move_4 = Move(Geometry=combine.Result, Motion=Z_3)  # -> Geometry, Transform

# ---- group: Let the roof tilt
lng_2 = ListLength(List=move_3.Geometry)
item_4 = ListItem(List=move_3.Geometry, Index=expr("X/2-1", lng_2), Wrap=True)
Y = UnitY(Factor=tilt_of_shells)
move_5 = Move(Geometry=item_4, Motion=Y)  # -> Geometry, Transform
replace = ReplaceItems(List=move_3.Geometry, Item=move_5.Geometry, Indices=expr("x/2-1", lng_2), Wrap=False)
lng_3 = ListLength(List=move_3.Geometry)
item_5 = ListItem(List=move_4.Geometry, Index=0, Wrap=True)
item_6 = ListItem(List=move_4.Geometry, Index=expr("x-1", lng_3), Wrap=True)
replace_2 = ReplaceItems(List=replace, Item=item_5, Indices=0, Wrap=False)
replace_3 = ReplaceItems(List=replace_2, Item=item_6, Indices=expr("x-1", lng_3), Wrap=False)

# ---- group: Interpolate points till curve
intcrv_3 = Interpolate(Vertices=move_4.Geometry, Degree=3, Periodic=False, KnotStyle=1)  # -> Curve, Length, Domain
intcrv_4 = Interpolate(Vertices=replace_3, Degree=3, Periodic=False, KnotStyle=1)  # -> flatten(Curve), Length, Domain

# ----
crv = Curve(flatten(intcrv_3.Curve))
crv_2 = Curve(flatten(intcrv_4.Curve))

# ---- group: get the correct subsets of arches to loft
dom = ConstructDomain(DomainStart=1, DomainEnd=amount_of_shells)
dom_2 = ConstructDomain(DomainStart=1, DomainEnd=amount_of_shells)
dom_3 = ConstructDomain(DomainStart=1, DomainEnd=amount_of_shells)
dom_4 = ConstructDomain(DomainStart=0, DomainEnd=amount_of_shells)
subset = SubList(List=crv, Domain=dom_4, Wrap=True)  # -> simplify(graft(List)), Index
subset_2 = SubList(List=crv, Domain=dom, Wrap=True)  # -> simplify(graft(List)), Index
subset_3 = SubList(List=crv_2, Domain=dom_2, Wrap=True)  # -> simplify(graft(List)), Index
subset_4 = SubList(List=crv_2, Domain=dom_3, Wrap=True)  # -> simplify(graft(List)), Index

# ---- group: Give the interlaying panels a depth
loft = Loft(
    Curves=[subset_3.List, subset_2.List],
    Options={Adjust=False, Closed=False, LoftEnds=0, LoftSimp=0, LoftType=0, Rebuild=10, Refit=0.01})
offset = OffsetSurface(Surface=loft, Distance=expr("-x", depth_glass), Retrim=True)
loft_2 = Loft(Curves=[offset, loft], Options={Adjust=False, Closed=False, LoftEnds=0, LoftSimp=0, LoftType=0, Rebuild=10, Refit=0.01})
join = BrepJoin(Breps=[offset, loft, loft_2])  # -> Breps, Closed
Z_5 = UnitZ(Factor=thickness_shell)
move_6 = Move(Geometry=join.Breps, Motion=expr("-x", Z_5))  # -> Geometry, Transform

# ---- group: Add BIM data
bim_type = BIMTypes({"BimGenericBuildingElt": 0, "BimSection": 1, "BimWall": 2, "BimWindow": 3, "BimDoor": 4, "BimColumn": 5, "BimSlab": 6, "BimBeam": 7, "BimRoom": 8, "BimCovering": 9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}, selected="BimWindow")
building = Buildings({"Canopy"}, selected="Canopy")
bim_type_2 = BIMTypes({"BimGenericBuildingElt": 0, "BimSection": 1, "BimWall": 2, "BimWindow": 3, "BimDoor": 4, "BimColumn": 5, "BimSlab": 6, "BimBeam": 7, "BimRoom": 8, "BimCovering": 9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}, selected="BimColumn")
bim_type_3 = BIMTypes({"BimGenericBuildingElt": 0, "BimSection": 1, "BimWall": 2, "BimWindow": 3, "BimDoor": 4, "BimColumn": 5, "BimSlab": 6, "BimBeam": 7, "BimRoom": 8, "BimCovering": 9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}, selected="BimRoof": 18)
st = Stories(Building=building)

# ---- group: Make supporting columns
item_7 = ListItem(List=move_3.Geometry, Index=[1, 5, 2, 4], Wrap=True)  # -> simplify(Item)
item_8 = ListItem(List=move_4.Geometry, Index=[0, 6, 2, 4], Wrap=True)  # -> simplify(Item)
flip = FlipMatrix(Data=item_7)
flip_2 = FlipMatrix(Data=item_8)
shift = ShiftList(List=flip, Shift=1, Wrap=False)  # -> simplify(List)
ln_2 = Line(StartPoint=shift, EndPoint=flip_2)
lng_4 = ListLength(List=ln_2)
cull_i = CullIndex(List=ln_2, Indices=expr("x-1", lng_4), Wrap=True)  # -> simplify(List)
divide_5 = DivideCurve(Curve=cull_i, Count=2, Kinks=False)  # -> Points, Tangents, Parameters
Z_6 = UnitZ(Factor=thickness_shell)
item_9 = ListItem(List=divide_5.Points, Index=1, Wrap=True)
move_7 = Move(Geometry=item_9, Motion=expr("-x", Z_6))  # -> Geometry, Transform
project = Project(Geometry=move_7.Geometry, Plane=PlaneXY(0, 0, 0))  # -> Geometry, Transform
ln_3 = Line(StartPoint=move_7.Geometry, EndPoint=project.Geometry)
eval = EvaluateCurve(Curve=ln_3, Parameter=1)  # -> Point, Tangent, Angle
eval_2 = EvaluateCurve(Curve=ln_3, Parameter=0.4)  # -> Point, Tangent, Angle
eval_3 = EvaluateCurve(Curve=ln_3, Parameter=0)  # -> Point, Tangent, Angle
pl = PlaneNormal(Origin=eval.Point, ZAxis=eval.Tangent)
pl_2 = PlaneNormal(Origin=eval_2.Point, ZAxis=eval_2.Tangent)
pl_3 = PlaneNormal(Origin=eval_3.Point, ZAxis=eval_3.Tangent)
cir = Circle(Plane=pl, Radius=Slider(500, range=0..1000))
cir_2 = Circle(Plane=pl_2, Radius=Slider(300, range=0..1000))
cir_3 = Circle(Plane=pl_3, Radius=Slider(1500, range=0..1500))
graft = GraftTree(Tree=flatten(cir), IncludeEmptyLists=True, IncludeNullItems=True)
graft_2 = GraftTree(Tree=flatten(cir_2), IncludeEmptyLists=True, IncludeNullItems=True)

# ---- group: Make the shells from loft of curves
loft_3 = Loft(
    Curves=[subset.List, subset_4.List],
    Options={Adjust=False, Closed=False, LoftEnds=0, LoftSimp=0, LoftType=0, Rebuild=10, Refit=0.01})  # -> flatten(Loft)
clean = CleanTree(RemoveNulls=True, RemoveInvalid=True, RemoveEmpty=False, Tree=loft_3)

# ---- group: Make the shells hang over
extendsrf = PythonScript(srf=clean, distance1=1, distance2=1, distance3=shell_overhang, distance4=1)  # -> out, finalSrf; inputs srf: Surface
# ---------- extendsrf: Python ----------
import Rhino as rc


stat1 = rc.Geometry.IsoStatus.North
stat2 = rc.Geometry.IsoStatus.South
stat3 = rc.Geometry.IsoStatus.East
stat4 = rc.Geometry.IsoStatus.West

if distance1 != 0:
    oneSideExSrf = srf.Extend(stat1, distance1, True)
else:
    oneSideExSrf = srf
if distance2 != 0:
    twoSideExSrf = oneSideExSrf.Extend(stat2, distance2, True)
else:
    twoSideExSrf = oneSideExSrf
if distance3 != 0:
    threeSideExSrf = twoSideExSrf.Extend(stat3, distance3, True)
else:
    threeSideExSrf = twoSideExSrf
if distance4 != 0:
    finalSrf = threeSideExSrf.Extend(stat4, distance4, True)
else:
    threeSideExSrf = twoSideExSrf
# ---------- end extendsrf ----------
brep = Brep(extendsrf.finalSrf)

# ---- group: Make the shells from loft of curves (continued)
offset_2 = OffsetSurface(Surface=brep, Distance=thickness_shell, Retrim=True)
debrep = DeconstructBrep(Brep=offset_2)  # -> Faces, flatten(Edges), Vertices
debrep_2 = DeconstructBrep(Brep=brep)  # -> Faces, flatten(Edges), Vertices
graft_3 = GraftTree(Tree=debrep.Edges, IncludeEmptyLists=True, IncludeNullItems=True)
graft_4 = GraftTree(Tree=debrep_2.Edges, IncludeEmptyLists=True, IncludeNullItems=True)
loft_4 = Loft(
    Curves=[graft_4, graft_3],
    Options={Adjust=False, Closed=False, LoftEnds=0, LoftSimp=0, LoftType=0, Rebuild=10, Refit=0.01})  # -> flatten(Loft)
flatten = FlattenTree(Tree=debrep.Faces, Path="{0}")
flatten_2 = FlattenTree(Tree=debrep_2.Faces, Path="{0}")
join_2 = BrepJoin(Breps=[flatten_2, loft_4, flatten])  # -> Breps, Closed

# ----
brep_2 = Brep(join_2.Breps)

# ---- group: Make supporting columns (continued)
project_2 = Project(Curve=flatten(cir_3), Brep=[brep_2, brep_2, brep_2, brep_2], Direction=Vector(0, 0, 1))
shift_2 = ShiftList(List=project_2, Shift=1, Wrap=True)
culln = CullNth(List=shift_2, CullFrequency=2)  # -> simplify(flatten(List))
graft_5 = GraftTree(Tree=culln, IncludeEmptyLists=True, IncludeNullItems=True)
loft_5 = Loft(
    Curves=[graft, graft_2, graft_5],
    Options={Adjust=False, Closed=False, LoftEnds=0, LoftSimp=0, LoftType=3, Rebuild=10, Refit=0.01})

# ---- group: OUTPUT to bake
bbe = BakeBuildingElement(Geometry=loft_5, ElementType=bim_type_2, SpatialLocation=st)
bbe_2 = BakeBuildingElement(Geometry=brep_2, ElementType=bim_type_3, SpatialLocation=st)
bbe_3 = BakeBuildingElement(Geometry=move_6.Geometry, ElementType=bim_type, SpatialLocation=st)
